# Grasshopper definition tensegrity_06.gh (Grasshopper 0.9.76)
# plug-ins: Python Interpreter

pt = Point("0.0,0.0,0.0")
python = PythonScript(numberSides=Slider(6, range=3..6), radius=Slider(2.7, range=-2..6), altura=Slider(4.6, range=-2..6), centerPt=pt)  # -> out, a, b, c, d; inputs numberSides: Int32, centerPt: Point3d
# ---------- python: Python ----------
import rhinoscriptsyntax as rs
import Rhino as rh
import math

#setup array para manter vértices e variáveis de círculo ou polígono para rastrear angular
#incremento em torno dos lados dos círculos ou polígono
pointList = []
curAngle = 0
delAngle = 360/numberSides

print('Tensegrity simple')

# while loop se move ao redor do perímetro do círculo e determina
while (curAngle <= 360):
    x = centerPt.X + math.cos(math.radians(curAngle)) * radius
    y = centerPt.Y + math.sin(math.radians(curAngle)) * radius
    z = centerPt.Z
    pt = rh.Geometry.Point3d(x, y, z)
    pt2 = rh.Geometry.Point3d(x, y, altura) 
    curAngle += delAngle
    pointList.append(pt)
    pointList.append(pt2)

a = pointList
print(a)

# criar as barras
bar1 = rs.AddLine(pointList[0], pointList[9])
bar2 = rs.AddLine(pointList[2], pointList[11])
bar3 = rs.AddLine(pointList[4], pointList[1])
bar4 = rs.AddLine(pointList[6], pointList[3])
bar5 = rs.AddLine(pointList[8], pointList[5])
bar6 = rs.AddLine(pointList[10], pointList[7])



# create the interstitial tendons
interstitials = []
numPoint = (len(pointList) - 2)
cont = 0

while cont < numPoint:
    interstitial = rs.AddLine(pointList[cont], pointList[cont + 3])
    interstitials.append(interstitial )
    cont += 2

# cria linhas verticais
inferior = polyline = rs.AddPolyline(pointList[:13:2])
superior = polyline = rs.AddPolyline(pointList[1:14:2])

#print(pointList)
a = interstitials
b = [bar1, bar2, bar3, bar4, bar5, bar6]
c = pointList
d = [superior, inferior]
# ---------- end python ----------
pipe = Pipe(Curve=python.b, Radius="0.08", Caps=2)
pipe_2 = Pipe(Curve=python.d, Radius="0.01", Caps=0)
pipe_3 = Pipe(Curve=python.a, Radius="0.01", Caps=0)
panel = Panel(python.c)
preview = CustomPreview(Geometry=pipe, Shader=ColourSwatch(SwatchColor=RGB(252, 223, 0)))
preview_2 = CustomPreview(Geometry=pipe_2, Shader=ColourSwatch(SwatchColor=RGB(171, 29, 150)))
preview_3 = CustomPreview(Geometry=pipe_3, Shader=ColourSwatch(SwatchColor=RGB(250, 130, 32)))
