# Grasshopper definition truss_tensegrity.gh (Grasshopper 0.9.76)
# plug-ins: Python Interpreter

python = PythonScript(x=Slider(0.8, range=0..3), y=Slider(2, range=0..10))  # -> out, support, beam, cable
# ---------- python: Python ----------
import rhinoscriptsyntax as rs

#points
list = [[0,0,0],[y,0,x],[y,0,-x],[y+4,0,x],[y+4,0,-x],[y+6,0,0]]

cont = 0
a = []
for i in range(6):
    points = rs.AddPoint(list[cont])
    a.append(points)
    cont += 1

#bars
cont = 1
b = []
for i in range(2):
    bars = rs.AddLine(a[cont], a[cont + 1])
    b.append(bars)
    cont += 2

#line
c = []
line1 = rs.AddLine(a[0],a[1])
c.append(line1)
line2 = rs.AddLine(a[1],a[3])
c.append(line2)
line3 = rs.AddLine(a[3],a[5])
c.append(line3)
line4 = rs.AddLine(a[5],a[4])
c.append(line4)
line5 = rs.AddLine(a[4],a[2])
c.append(line5)
line6 = rs.AddLine(a[2],a[0])
c.append(line6)

#outputs
support = a[0], a[5]
beam = b
cable = c
# ---------- end python ----------
steel_cable = Line(python.cable)
support = Point(python.support)
panel = Panel(python.support)
pipe = Pipe(Curve=python.beam, Radius=0.05, Caps=0)
pipe_2 = Pipe(Curve=steel_cable, Radius="0.01", Caps=0)
preview = CustomPreview(Geometry=pipe_2, Shader=ColourSwatch(SwatchColor=RGB(171, 29, 150)))
preview_2 = CustomPreview(Geometry=pipe, Shader=ColourSwatch(SwatchColor=RGB(252, 223, 0)))
