# Grasshopper definition truss_set.gh (Grasshopper 0.9.76)
# plug-ins: Python Interpreter

python = PythonScript(x=Slider(13, range=0..40), y=Slider(1, range=0..10), z=Slider(1.57, range=0..10), segments=Slider(5, range=0..10))  # -> out, a, b, c, d, e
# ---------- python: Python ----------
import rhinoscriptsyntax as rs
import Rhino as rc

#Criar classe Line, Divide, Move, Bars, etc, instanciar no for

i = 0
listLine = []
for i in range(4):
    line = rs.AddLine((0,y,0),(x,y,0))
    listLine.append(line)
    i += 1
print listLine
a = listLine[0]

#divide linha
i = 0
listDivide = []
for i in range(4):
    divide = rs.DivideCurve(listLine[i], segments, create_points=False, return_points=True)
    listDivide.append(divide)
    i += 1

point = listDivide[1]
b = point[1]

#move pontos
i = 0
listMoveSup = []
listMoveInf = []
for i in range(4):
    myVector1 = rc.Geometry.Vector3d(0,0,z)
    move1 = b + myVector1 #b (pq listDivide devolve uma lista, precisa escolher uma linha e depois escolher um ponto dessa linha, seguir..)
    listMoveSup.append(move1)
    myVector2 = rc.Geometry.Vector3d(0,0,-z)
    move2 = b + myVector2
    listMoveInf.append(move2)
c = listMoveSup[0]
d = listMoveInf[0]

#bars
i = 0
bars = []
for i in range(4):
    bar = rs.AddLine(listMoveSup[i], listMoveInf[i])
    bars.append(bar)
    i += 1
e = bars[0]
# ---------- end python ----------
python_2 = PythonScript()  # -> out, a, b, c, d, e, f, g, h, i
# ---------- python_2: Python ----------
import rhinoscriptsyntax as rs
import Rhino as rc

def LinhaMestre(start, end):
    """constroir linha"""
    return rs.AddLine(start, end)

def DivideLinha(curve_id, segments, create_points=False, return_points=True):
    """divide linha"""
    return rs.DivideCurve(curve_id, segments, create_points=False, return_points=True)

def EscolhaPonto(lista, ponto):
    """criar função para esta escolha também"""
    escolherLista = lista
    x, y = escolherLista[ponto], escolherLista[- ponto - ponto]
    return x, y

def MoverPontos(grupo, z):
    """Move pontos"""
    ponto_um = grupo[0]
    ponto_dois = grupo[1]
    myVector = rc.Geometry.Vector3d(0,0, z)
    move_um, move_dois = ponto_um + myVector, ponto_dois + myVector
    return move_um, move_dois

def Bars(start, end):
    """constroir linha"""
    i = 0
    bars = []
    for i in range(2):
        bar = rs.AddLine(start[i], end[i])
        bars.append(bar)
        i += 1
    return bars

#funções criadas, agora basta construir nossa treliça, fazemos isso chamando nossas funções

i = 0  # contador
a = []
b = [] # 4 listas de pontos, uma para cada linha
c = []
d = []
e = []
f = []
g = []
h = []
i = []

for i in range(4):
    #linhas mestres (ok)
    linhas = LinhaMestre((0,i,0),(10,i,0))
    a.append(linhas)
    # divide linhas mestres (ok)
    divideLinhas = DivideLinha(a[i], 6)
    b.append(divideLinhas)
    # escolhe os pontos (ok) 
    escolhePontos = EscolhaPonto(b[i], 1)
    c.append(escolhePontos)
    #move superiores
    moverPontoSup = MoverPontos(c[i], 1)  
    d.append(moverPontoSup)                  
    #move inferiores
    moverPontoInf = MoverPontos(c[i], -1)
    e.append(moverPontoInf)
    #cria barras
    barras = Bars(d[i], e[i])
    f.append(barras[0])
    g.append(barras[1])


    i += 1

#CABOS

j = 0

for j in range(4):
    start = b[j]
    end = d[j]
    cabos = rs.AddLine(start[0],end[0])
    h.append(cabos)
    j += 1
# ---------- end python_2 ----------
pt = Point(python.d)
pt_2 = Point(python.c)
line = Line(python.a)
geo = Geometry(python.e)
viewer = ParamViewer(python_2.d)
panel = Panel(python_2.f)
panel_2 = Panel(python.out)
